# Grasshopper definition VisualizeDataExample.gh (Grasshopper 1.0.7)
# plug-ins: VisFroG

path = FilePath("..\example\ExampleData.csv")
file = ReadFile(File=path, PerLineParse=True)
panel = Panel(""",
 """)
split = TextSplit(Text=file, Separators=panel)
domain = Domain(Domain(3, 29))
subset = SubList(List=split, Domain=domain, Wrap=True)  # -> List, Index
panel_2 = Panel(subset.List)
visfrog = VISualizationFRameworkFOrGrasshopper(GenericInputData=subset.List)
# Value '1' means selected
panel_3 = Panel(visfrog)
