# Grasshopper definition example.gh (Grasshopper 1.0.8)
# plug-ins: VisuAlFroG

input_data_path = Panel("C:\Users\marku\Documents\Git\GitHubEnterprise\VisuAlFroG\example\example-data.csv")
path = FilePath(input_data_path)
separator = Panel(";")
file = ReadFile(File=path, PerLineParse=True)
split = TextSplit(Text=file, Separators=separator)
panel = Panel(split)
command_line_arguments = Panel("--config C:\Users\marku\Documents\Git\GitHubEnterprise\VisuAlFroG\example\visualfrog_configuration.json")
visualfrog = VisualAnalyticsFrameworkForGrasshopper(GenericInputData=split, CommandLineArguments=command_line_arguments)
output = Panel(visualfrog)
