# Grasshopper definition linking.gh (Grasshopper 1.0.8)
# plug-ins: VisuAlFroG

eval = Evaluate(E="(x*y)-z*2+x", x=Slider(0.554, range=0..1), y=Slider(0.394, range=0..1), z=Slider(0.46, range=0..1))
num = Number(eval)
visualfrog = VisualAnalyticsFrameworkForGrasshopper()
panel = Panel(num)
panel_2 = Panel(visualfrog)
